test file "Transmission_Test_Suite"

suite "10-Speed Transmission Controller"

  case "ETRS 3" [baseline]
    model TransmissionSystem, mode Normal, start time 0, stop time 65
    assessment "ETRS 3.1": At any point of time, whenever DriveRangeSelector == Park & VehicleSpeed <= 0.1 is true then, with no delay, GearCommanded == 0 must be true
      GearCommanded: signal TransmissionControl/Transmission Controller, port 2
      DriveRangeSelector: signal TransmissionControl/Variant Source2, port 1
      VehicleSpeed: signal TransmissionControl/LongitudinalVehiclePlant, port 3
      Park: expression RangeSelected.Park

  case "ETRS 4" [simulation]
    model TransmissionSystem, variant configuration Test
    input "ETRS_0-60Log.mat", mapped to DriverBrake, DriverThrottle, DriverGearSelection (active)
    assessment "ETRS 4": At any point of time, if VehSpd > 0.1 becomes true then, with a delay of at most 12, VehSpd > 60 must be true
      VehSpd: signal TransmissionControl/Signal Specification, port 1

  case "Park Engagement" [baseline]
    model TransmissionSystem, mode Normal, start time 0, stop time 65
    input "Park_engagement_input.mat", mapped to DriverBrake, DriverThrottle, DriverGearSelection (active)
    assessment "Park Engagement Assessment": At any point of time, whenever (DriveRangeSelector == Park) is true then, with a delay of at most 0.02, GearCommanded == 0 must be true
      GearCommanded: signal TransmissionControl/Transmission Controller, port 2
      DriveRangeSelector: signal TransmissionControl/Variant Source2, port 1
      Park: expression RangeSelected.Park

  case "Drive shift safety" [baseline]
    model TransmissionSystem, mode Normal, start time 0, stop time 65
    input "ETRS_DriverLog.mat", mapped to DriverBrake, DriverThrottle, DriverGearSelection (active)
    assessment "Drive Shift Assesment": At any point of time, whenever (DriveRangeSelector == Drive ) & ( VehicleSpeed <= -0.5) is true then, with a delay of at most 0.02, GearCommanded  <= 0 must be true
      GearCommanded: signal TransmissionControl/Transmission Controller, port 2
      DriveRangeSelector: signal TransmissionControl/Variant Source2, port 1
      VehicleSpeed: signal TransmissionControl/LongitudinalVehiclePlant, port 3
      Drive: expression RangeSelected.Drive

  case "Reverse shift safety" [baseline]
    model TransmissionSystem, mode Normal, start time 0, stop time 65
    input "ETRS_DriverLog.mat", mapped to DriverBrake, DriverThrottle, DriverGearSelection (active)
    assessment "Reverse Safety Asessement": At any point of time, whenever (DriveRangeSelector == Reverse ) &( VehicleSpeed <0.5) is true then, with no delay, GearCommanded == -1 must be true
      GearCommanded: signal TransmissionControl/Transmission Controller, port 2
      DriveRangeSelector: signal TransmissionControl/Variant Source2, port 1
      VehicleSpeed: signal TransmissionControl/LongitudinalVehiclePlant, port 3
      Reverse: expression RangeSelected.Reverse

  case "Neutral Operation" [baseline]
    model TransmissionSystem, mode Normal, start time 0, stop time 65
    input "ETRS_DriverLog.mat", mapped to DriverBrake, DriverThrottle, DriverGearSelection (active)
    assessment "Neutral Operation Assessment": At any point of time, whenever DriveRangeSelector == Neutral is true then, with a delay of at most 0.02, GearCommanded == 0 must be true
      GearCommanded: signal TransmissionControl/Transmission Controller, port 2
      DriveRangeSelector: signal TransmissionControl/Variant Source2, port 1
      Neutral: expression RangeSelected.Neutral

  case "Park Engagement Timing" [baseline]
    model TransmissionSystem, mode Normal, start time 0, stop time 65
    input "Park_engagement_input.mat", mapped to DriverBrake, DriverThrottle, DriverGearSelection (active)
    assessment "Park engagement timing assessment": At any point of time, whenever (DriveRangeSelector == Park) & (VehicleSpeed < 0.1) & (VehicleSpeed > -0.1) is true then, with a delay of at most 0.01, ParkingBrakeCommand must be true
      DriveRangeSelector: signal TransmissionControl/Variant Source2, port 1
      VehicleSpeed: signal TransmissionControl/LongitudinalVehiclePlant, port 3
      Park: expression RangeSelected.Park
      ParkingBrakeCommand: signal TransmissionSystem/Transmission Controller|TransmissionController/Logical Operator, port 1

  case "Park Release Timing" [baseline]
    model TransmissionSystem, mode Normal, start time 0, stop time 65
    input "ETRS_DriverLog.mat", mapped to DriverBrake, DriverThrottle, DriverGearSelection (active)
    assessment "Park Release Timing Assessment": At any point of time, whenever DriveRangeSelector ~= Park is true then, with a delay of at most 0.1, ~ParkingBrakeCommand must be true
      DriveRangeSelector: signal TransmissionControl/Variant Source2, port 1
      Park: expression RangeSelected.Park
      ParkingBrakeCommand: signal TransmissionSystem/Transmission Controller|TransmissionController/Logical Operator, port 1

  case "Maximum Engine Speed" [baseline]
    model TransmissionSystem, mode Normal, start time 0, stop time 65
    input "ETRS_0-60Log.mat", mapped to DriverBrake, DriverThrottle, DriverGearSelection (active)
    assessment "Max Engine Speed Assessment": At any point of time, whenever EngineSpeed >=0 is true then, with no delay, EngineSpeed <= 7250 must be true
      EngineSpeed: signal TransmissionSystem/Transmission Controller|TransmissionController/Engine Speed, port 1

  case "Minimum Engine Speed" [baseline]
    model TransmissionSystem, mode Normal, start time 0, stop time 65
    input "ETRS_0-60Log.mat", mapped to DriverBrake, DriverThrottle, DriverGearSelection (active)
    assessment "Min Engine Speed Assessment": At any point of time, whenever EngineSpeed >=0 is true then, with no delay, EngineSpeed >= 800 must be true
      EngineSpeed: signal TransmissionSystem/Transmission Controller|TransmissionController/Engine Speed, port 1